% Simulink data dictionary REL.sldd

Rat_Sts_E = enum(DefaultValue="Rat_Invalid", StorageType="uint8")
  Rat_Invalid = 0
  Rat_All_Lock = 1
  Rat_Half_Lock = 2
  Rat_Unlock = 3

Mot_Cmd_E = enum(DefaultValue="Stop", StorageType="uint8")
  Stop = 0
  Rls = 1
  Reset = 2

Door_Sts_E = enum(DefaultValue="Door_Lock", StorageType="uint8")
  Door_Lock = 0
  Door_Unlock = 1
  Door_Not_Used = 2
  Door_Error = 3